% Requirement links of pwmCnv.slx (R2018a)

model links to throttleReqs.doc#@pwm_1: pwm_1: Duty cycle must be proportional ...
model links to throttleReqs.doc#@pwm_2: pwm_2: PWM torque should act in positiv...
model links to throttleReqs.doc#@pwm_3: pwm_3: PWM torque should act in negativ...
model links to throttleReqs.doc#@pwm_4: pwm_4: Duty cycle must be in range from 0 to 1.